# Grasshopper definition Algoritmo_firefly_Plaster.gh (Grasshopper 0.9.14)
# plug-ins: Python Interpreter, Firefly

ports_available = COMPortsAvailable()
panel = Panel(ports_available)
toggle = BooleanToggle(True)
int = Integer(11)
timer = Timer(TimerInterval=5, Target=uno_read)
open_port = OpenClosePort(OpenClosePort=toggle, PortNumber=int, BaudRate=115200)
uno_read = UnoRead(StartReadingValues=toggle, PortNumber=int)  # -> AnalogPin0, AnalogPin1, AnalogPin2, AnalogPin3, AnalogPin4, AnalogPin5, DigitalPin2, DigitalPin4, DigitalPin7, StatusMessage
potenziometro_1 = Panel(uno_read.AnalogPin1)
potenziometro_2 = Panel(uno_read.AnalogPin0)
remap = RemapNumbers(Value=potenziometro_2, Source="0.0 To 1023.0", Target="30 To 76")
remap_2 = RemapNumbers(Value=potenziometro_1, Source="0.0 To 1023.0", Target="10 To 33")
int_2 = Integer(remap)
int_3 = Integer(remap_2)
plaster_style = Panel(uno_read.DigitalPin2)
lunghezza = Panel(int_2)
spessore = Panel(int_3)

larghezza = Panel(lunghezza)
spessore_2 = Panel(spessore)
plaster_style_2 = Panel(plaster_style)

s_1 = Panel("1.4")
s_2 = Panel("0.8")

offset_holls = Panel("0.2")
h_holls = Panel("0.8")

pt = Point(<point referenced from the Rhino model>)
pt_2 = Point(<point referenced from the Rhino model>)
tag = TextTag3D(Location=pt, Text=larghezza, Size="7")
tag_2 = TextTag3D(Location=pt_2, Text=spessore_2, Size="7")

python = PythonScript(x=plaster_style_2, y=ColourSwatch(SwatchColor=RGB(125, 16, 16)))  # -> out, a, b; inputs x: Int32
# ---------- python: Python ----------
if x == 1:
    a=y
elif x==0:
    b=y
else:
    print "ciao"
# ---------- end python ----------
panel_2 = Panel(python.out)

pt_3 = PointXYZ(XComponent=0, YComponent=0, ZComponent=0, System=PlaneXY(0, 0, 0))
pt_4 = PointXYZ(XComponent=larghezza, YComponent=0, ZComponent=0, System=PlaneXY(0, 0, 0))
division = Division(A=spessore_2, B=2)
division_2 = Division(A=larghezza, B=2)
Y = UnitY(Factor=spessore_2)
ln = Line(StartPoint=pt_3, EndPoint=pt_4)
subtraction = Subtraction(A=spessore_2, B="2.5")
division_3 = Division(A=subtraction, B=2)
move = Move(Geometry=ln, Motion=Y)  # -> Geometry, Transform
end = EndPoints(Curve=move.Geometry)  # -> Start, End
end_2 = EndPoints(Curve=ln)  # -> Start, End
subtraction_2 = Subtraction(A=division_2, B=division_3)
subtraction_3 = Subtraction(A=division, B=division_3)
X = UnitX(Factor=1)
X_2 = UnitX(Factor=1)
pt_5 = PointXYZ(XComponent=subtraction_2, YComponent=subtraction_3, ZComponent=0, System=PlaneXY(0, 0, 0))
xy = XYPlane(Origin=Point(0, 0, 0))
arc = ArcSED(Start=end_2.Start, End=end.Start, Direction=expr("D*-1", X_2))  # -> Arc, Plane, Radius
arc_2 = ArcSED(Start=end_2.End, End=end.End, Direction=X)  # -> Arc, Plane, Radius
pl_origin = PlaneOrigin(Base=xy, Origin=pt_5)
join = JoinCurves(Curves=[ln, move.Geometry, arc_2.Arc, arc.Arc], Preserve=False)
rectangle = Rectangle(Plane=pl_origin, XSize=subtraction, YSize=subtraction, Radius=2)  # -> Rectangle, Length
Z = UnitZ(Factor=s_1)
move_2 = Move(Geometry=rectangle.Rectangle, Motion=Z)  # -> Geometry, Transform
planar = PlanarSrf(Edges=join)
planar_2 = PlanarSrf(Edges=move_2.Geometry)
Z_2 = UnitZ(Factor=s_2)
extr = Extrude(Base=planar, Direction=Z)
rectangle_2 = Rectangle(Plane=pl_origin, XSize=subtraction, YSize=subtraction, Radius=0)  # -> Rectangle, Length
extr_2 = Extrude(Base=planar_2, Direction=Z_2)

panel_3 = Panel(subtraction)
explode = Explode(Curve=move_2.Geometry, Recursive=True)  # -> Segments, Vertices
eval = Evaluate(F="x/3", x=panel_3)
int_4 = Integer(eval)
item = ListItem(List=explode.Segments, Index=0, Wrap=False)
item_2 = ListItem(List=explode.Segments, Index=4, Wrap=False)
divide = DivideCurve(Curve=item, Count=int_4, Kinks=False)  # -> Points, Tangents, Parameters
divide_2 = DivideCurve(Curve=item_2, Count=int_4, Kinks=False)  # -> Points, Tangents, Parameters
rev = ReverseList(List=divide.Points)
ln_2 = Line(StartPoint=rev, EndPoint=divide_2.Points)
series = Series(Start=0, Step=2, Count=expr("(C+2)/2", int_4))
series_2 = Series(Start=1, Step=2, Count=expr("(C+1)/2", int_4))
int_5 = Integer(0)
item_3 = ListItem(List=ln_2, Index=series_2, Wrap=False)
item_4 = ListItem(List=ln_2, Index=series, Wrap=False)
panel_4 = Panel([int_5, int_4])
divide_3 = DivideCurve(Curve=item_4, Count=int_4, Kinks=False)  # -> Points, Tangents, Parameters
divide_4 = DivideCurve(Curve=item_3, Count=int_4, Kinks=False)  # -> Points, Tangents, Parameters
cyl = Cylinder(Base=divide_3.Points, Radius=1, Length=h_holls)
cyl_2 = Cylinder(Base=divide_4.Points, Radius=1, Length=h_holls)
cull_i = CullIndex(List=cyl, Indices=panel_4, Wrap=False)
cull_i_2 = CullIndex(List=cyl_2, Indices=panel_4, Wrap=False)
cull_i_3 = CullIndex(List=cull_i, Indices=series, Wrap=False)
cull_i_4 = CullIndex(List=cull_i_2, Indices=series_2, Wrap=False)
Z_3 = UnitZ(Factor=offset_holls)
move_3 = Move(Geometry=[cull_i_3, cull_i_4], Motion=Z_3)  # -> Geometry, Transform
cap = CapHoles(Brep=move_3.Geometry)

sunion = SolidUnion(Breps=[extr, extr_2, move_3.Geometry])

pcen = PolygonCenter(Polyline=rectangle_2.Rectangle)  # -> CenterV, CenterE
xy_2 = XYPlane(Origin=Point(0, 0, 0))
rad = Radians(Degrees=90)
pl_origin_2 = PlaneOrigin(Base=xy_2, Origin=pcen.CenterV)
rotate = Rotate(Geometry=extr, Angle=rad, Plane=pl_origin_2)  # -> Geometry, Transform
sunion_2 = SolidUnion(Breps=[extr, extr_2, move_3.Geometry, rotate.Geometry])

division_4 = Division(A=larghezza, B=2)
division_5 = Division(A=spessore_2, B=2)
neg = Negative(Value=division_5)
neg_2 = Negative(Value=division_4)
pt_6 = PointXYZ(XComponent=neg_2, YComponent=neg, ZComponent=0, System=PlaneXY(0, 0, 0))
pt_7 = PointXYZ(XComponent=0, YComponent=0, ZComponent=0, System=PlaneXY(0, 0, 0))
vec2pt = Vector2Pt(PointA=pt_7, PointB=pt_6, Unitize=False)  # -> Vector, Length
move_4 = Move(Geometry=sunion, Motion=vec2pt.Vector)  # -> Geometry, Transform
move_5 = Move(Geometry=sunion_2, Motion=vec2pt.Vector)  # -> Geometry, Transform

singolo = CustomPreview(Geometry=move_4.Geometry, Shader=python.b)
croce = CustomPreview(Geometry=move_5.Geometry, Shader=python.a)
